# Dynamo graph CreateContainer.dyn (Dynamo 0.8.1.1942)

# group: Curvature
number = DoubleInput(5)
select_edge = DSEdgeSelection()  # 1 picked in the model
select_edge_2 = DSEdgeSelection()  # 1 picked in the model

# group: Host Element
select_model_element = DSModelElementSelection()  # 1 picked in the model
id = Element.Id(select_model_element)

# group: Rebar Options
rebar_style = RebarStyle("Standard")
rebar_bar_type = RebarBarType("#6")
rebar_hook_orientation = RebarHookOrientation("Right")
rebar_hook_type = RevitRebarHookType("Standard - 90 deg.")

byCurve = Rebar.ByCurve(select_edge, id, rebar_style, rebar_bar_type, rebar_hook_orientation, rebar_hook_orientation, rebar_hook_type, rebar_hook_type)
byCurve_2 = Rebar.ByCurve(select_edge_2, id, rebar_style, rebar_bar_type, rebar_hook_orientation, rebar_hook_orientation, rebar_hook_type, rebar_hook_type)

# group: Create a Container
create = List.Create(byCurve, byCurve_2)
byBars = RebarContainer.ByBars(create)
