# Dynamo graph Generic Foundation.dyn (Dynamo 0.9.1.2992)

# group: Rebar Type
rebar_bar_type = RebarBarType("10 220S")

# group: Stirrup Settings
rebar_bar_type_2 = RebarBarType("10 220S")
rebar_hook_orientation = RebarHookOrientation("Left")
rebar_hook_type = RevitRebarHookType("Standard - 90 deg.")

# group: Geometry Selection
select_face = DSFaceSelection()  # 1 picked in the model
select_face_2 = DSFaceSelection()  # 1 picked in the model
select_model_element = DSModelElementSelection()  # 1 picked in the model

# group: Bar Distribution
cover_parameter = DoubleInput(200)
division = DoubleInput(4)

stirrup_distance = DoubleInput(200)
stirrup_distance_2 = DoubleInput(500)
stirrup_distance_3 = DoubleInput(200)
stirrup_distance_4 = DoubleInput(500)
foundation_rebar = Custom[Foundation Rebar](VerticalBarsBarType=rebar_bar_type, StirrupBarType=rebar_bar_type_2, StirrupHookOrientation=rebar_hook_orientation, StirrupHookType=rebar_hook_type, SurfaceBottom=select_face, SurfaceTop=select_face_2, VericalBarsCover=cover_parameter, VerticalBarsAmount=division, HostElement=select_model_element, StirrupRadius=stirrup_distance, VerticalBarsHookLength=stirrup_distance_2, VerticalBarsBendingRadius=stirrup_distance_3, StirrupDistance=stirrup_distance_4)  # Standard Rebar for Foundations
watch = Watch(foundation_rebar.0)
watch_2 = Watch(foundation_rebar.1)
