# Dynamo graph DynamoWorkspace.dyn (Dynamo 0.8.0.950)

select_edge = DSEdgeSelection()  # 1 picked in the model
select_edge_2 = DSEdgeSelection()  # 1 picked in the model
number = DoubleInput(10)
morphedRebar = Rebar.MorphedRebar(select_edge, select_edge_2, number)
select_model_element = DSModelElementSelection()  # 1 picked in the model
id = Element.Id(select_model_element)
byCurve = RebarContainer.ByCurve(morphedRebar, id)
select_face = DSFaceSelection()  # 1 picked in the model
number_2 = DoubleInput(4)
boolean = BoolSelector(false)
followingSurface = Rebar.FollowingSurface(select_face, number_2, arg3=boolean)
rebar_style = RebarStyle("Standard")
rebar_bar_type = RebarBarType("Structural Rebar 1")
rebar_hook_orientation = RebarHookOrientation("Right")
rebar_hook_type = RevitRebarHookType("Rebar Hook 90")
ZAxis = Vector.ZAxis()
byCurve_2 = RebarContainer.ByCurve(followingSurface, id, rebar_style, rebar_bar_type, rebar_hook_orientation, rebar_hook_orientation, rebar_hook_type, rebar_hook_type, ZAxis)
select_face_2 = DSFaceSelection()  # 1 picked in the model
select_faces = SelectFaces()  # 5 picked in the model
flatten = Flatten(select_faces)
number_3 = DoubleInput(0.5)
number_4 = DoubleInput(20)
boolean_2 = BoolSelector(true)
perpendicularRebar = Rebar.PerpendicularRebar(select_face_2, flatten, number_3, number_4, boolean_2)
flatten_2 = Flatten(perpendicularRebar)
select_model_element_2 = DSModelElementSelection()  # 1 picked in the model
id_2 = Element.Id(select_model_element_2)
byCurve_3 = RebarContainer.ByCurve(flatten_2, id_2)
byCurve_4 = Rebar.ByCurve()
